# Dynamo custom node ClashBB.dyf (Dynamo 0.7.2.2114)
# category: DynaWorks14.Custom
# Get XYZ of clashes

OpenNavisFile = Input()
getClashDetection = DynaWorks14.ClashDetection.ClashDetection.GetClashDetection(OpenNavisFile)
getClashTests = DynaWorks14.ClashDetection.ClashDetection.GetClashTests(getClashDetection)
getAllClashResults = DynaWorks14.ClashDetection.ClashDetection.GetAllClashResults(getClashTests)
getClashBoundingBox = DynaWorks14.ClashDetection.ClashDetection.GetClashBoundingBox(getAllClashResults)
BB = Output(getClashBoundingBox)
