# Dynamo custom node ClashID's.dyf (Dynamo 0.7.2.2114)
# category: DynaWorks14.Custom
# Get Object Clashing Element ID's

OpenNavisFile = Input()
getClashDetection = DynaWorks14.ClashDetection.ClashDetection.GetClashDetection(OpenNavisFile)
getClashTests = DynaWorks14.ClashDetection.ClashDetection.GetClashTests(getClashDetection)
getAllClashResults = DynaWorks14.ClashDetection.ClashDetection.GetAllClashResults(getClashTests)
FirstItem_bool = Input()  # "FirstItem (bool)"
getClashNodes = DynaWorks14.ClashDetection.ClashDetection.GetClashNodes(getAllClashResults, FirstItem_bool)
string = StringInput("LcRevitComposite")
nodeByClassNameList = DynaWorks14.Objects.NavisNodes.NodeByClassNameList(getClashNodes, string)
flatten = Flatten(nodeByClassNameList)
getNavisAttributesFromNodesList = DynaWorks14.Objects.NavisAttributes.GetNavisAttributesFromNodesList(flatten)
string_2 = StringInput("Element ID")
string_3 = StringInput("Value")
getValuesAsStringClassUserName = DynaWorks14.Objects.NavisPropertyList.GetValuesAsStringClassUserName(OpenNavisFile, getNavisAttributesFromNodesList, string_2, string_3)
flatten_2 = Flatten(getValuesAsStringClassUserName)
List = Output(flatten_2)
