# Dynamo custom node ClashID'sByGroupName.dyf (Dynamo 0.7.2.2114)
# category: DynaWorks14.Custom
# Get the Clashes from a Navis Clash Group

OpenNavisFile = Input()
getClashDetection = DynaWorks14.ClashDetection.ClashDetection.GetClashDetection(OpenNavisFile)
getClashTests = DynaWorks14.ClashDetection.ClashDetection.GetClashTests(getClashDetection)
getAllClashResults = DynaWorks14.ClashDetection.ClashDetection.GetAllClashResults(getClashTests)
flatten = Flatten(getAllClashResults)
getClashGroupResults = DynaWorks14.ClashDetection.ClashDetection.GetClashGroupResults(getClashTests)
string = StringInput("GroupPath")
getObjectValues = DynaWorks14.Objects.GetData.GetObjectValues(getClashGroupResults, string)
flatten_2 = Flatten(getObjectValues)
Group_Name = Input()
boolean = BoolSelector(true)
contains = String.Contains(flatten_2, Group_Name, boolean)
filterByBoolMask = List.FilterByBoolMask(flatten, contains)
First_Item_bool = Input()  # "First Item (bool)"
getClashNodes = DynaWorks14.ClashDetection.ClashDetection.GetClashNodes(filterByBoolMask, First_Item_bool)
string_2 = StringInput("LcRevitComposite")
nodeByClassNameList = DynaWorks14.Objects.NavisNodes.NodeByClassNameList(getClashNodes, string_2)
flatten_3 = Flatten(nodeByClassNameList)
getNavisAttributesFromNodesList = DynaWorks14.Objects.NavisAttributes.GetNavisAttributesFromNodesList(flatten_3)
string_3 = StringInput("Element ID")
string_4 = StringInput("Value")
getValuesAsStringClassName = DynaWorks14.Objects.NavisPropertyList.GetValuesAsStringClassName(OpenNavisFile, getNavisAttributesFromNodesList, string_3, string_4)
flatten_4 = Flatten(getValuesAsStringClassName)
List = Output(flatten_4)
