# Dynamo custom node ClashSuitableViews.dyf (Dynamo 0.7.2.2114)
# category: DynaWorks14.Custom
# Gets the Suitable View data from Navis for looking at clashes

OpenNavisFile = Input()
getClashDetection = DynaWorks14.ClashDetection.ClashDetection.GetClashDetection(OpenNavisFile)
getClashTests = DynaWorks14.ClashDetection.ClashDetection.GetClashTests(getClashDetection)
getAllClashResults = DynaWorks14.ClashDetection.ClashDetection.GetAllClashResults(getClashTests)
getSuitableEyePoint = DynaWorks14.ClashDetection.ClashDetection.GetSuitableEyePoint(getAllClashResults)
Camera = Output(getSuitableEyePoint)
getClashBoundingBox = DynaWorks14.ClashDetection.ClashDetection.GetClashBoundingBox(getAllClashResults)
BoundingBox = Output(getClashBoundingBox)
getSuitableDirectionPoint = DynaWorks14.ClashDetection.ClashDetection.GetSuitableDirectionPoint(getAllClashResults)
DirectionPoint = Output(getSuitableDirectionPoint)
