# Dynamo custom node ClashXYZ.dyf (Dynamo 0.7.2.2114)
# category: DynaWorks14.Custom
# Get XYZ of clashes

OpenNavisFile = Input()
getClashDetection = DynaWorks14.ClashDetection.ClashDetection.GetClashDetection(OpenNavisFile)
getClashTests = DynaWorks14.ClashDetection.ClashDetection.GetClashTests(getClashDetection)
getAllClashResults = DynaWorks14.ClashDetection.ClashDetection.GetAllClashResults(getClashTests)
First_Item_Bool = Input()  # "First Item (Bool)"
getClashPoint = DynaWorks14.ClashDetection.ClashDetection.GetClashPoint(getAllClashResults, First_Item_Bool)
Points = Output(getClashPoint)
