# Dynamo graph CreateSuitableRevitView.dyn (Dynamo 0.7.2.2114)

file_path = Filename("C:\Users\Adam_Sheather\Desktop\Stripe\DynaWorks Testing\File.nwf")
boolean = BoolSelector(true)
# note: Get Navisworks File
openFile = DynaWorks15.FileSettings.OpenNavisFile.OpenFile(file_path, boolean)
# note: Gets the Clash Detection Object
getClashDetection = DynaWorks15.ClashDetection.ClashDetection.GetClashDetection(openFile)
# note: Gets all the Clash Tests in the Clash Detection
getClashTests = DynaWorks15.ClashDetection.ClashDetection.GetClashTests(getClashDetection)
# note: Gets all the Results in the Clash Tests
getAllClashResults = DynaWorks15.ClashDetection.ClashDetection.GetAllClashResults(getClashTests)
flatten = Flatten(getAllClashResults)
# note: Get relevant Camera Properties in Metres for use in Node
mGetSuitableEyePoint = DynaWorks15.ClashDetection.ClashDetection.mGetSuitableEyePoint(flatten)
mGetSuitableDirectionPoint = DynaWorks15.ClashDetection.ClashDetection.mGetSuitableDirectionPoint(flatten)
mGetClashBoundingBox = DynaWorks15.ClashDetection.ClashDetection.mGetClashBoundingBox(flatten)
string = StringInput("name")
getObjectValues = DynaWorks15.Objects.GetData.GetObjectValues(flatten, string)
flatten_2 = Flatten(getObjectValues)
boolean_2 = BoolSelector(false)
byEyePointTargetAndBoundingBox = AxonometricView.ByEyePointTargetAndBoundingBox(mGetSuitableEyePoint, mGetSuitableDirectionPoint, mGetClashBoundingBox, flatten_2, boolean_2)
