# Dynamo graph NavisClashesElementUpdate.dyn (Dynamo 0.7.2.2114)

element_types = ElementTypes(index=80)
all_elements_of_type = ElementsOfType(element_types)
id = Element.Id(all_elements_of_type)
file_path = Filename("C:\Users\Adam_Sheather\Desktop\Stripe\DynaWorks Testing\File.nwf")
boolean = BoolSelector(true)
# note: Get Navisworks File
openFile = DynaWorks15.FileSettings.OpenNavisFile.OpenFile(file_path, boolean)
# note: Gets the Clash Detection Object
getClashDetection = DynaWorks15.ClashDetection.ClashDetection.GetClashDetection(openFile)
# note: Gets all the Clash Tests in the Clash Detection
getClashTests = DynaWorks15.ClashDetection.ClashDetection.GetClashTests(getClashDetection)
# note: Gets all the Results in the Clash Tests
getAllClashResults = DynaWorks15.ClashDetection.ClashDetection.GetAllClashResults(getClashTests)
boolean_2 = BoolSelector(true)
# note: Gets the Navisworks Objects from the Clash Test. Based on the first or second clashing item from the bool
getClashNodes = DynaWorks15.ClashDetection.ClashDetection.GetClashNodes(getAllClashResults, boolean_2)
string = StringInput("LcRevitComposite")
# note: Filters out the other Nodes except for the Family Instance.
nodeByClassNameList = DynaWorks15.Objects.NavisNodes.NodeByClassNameList(getClashNodes, string)
# note: Gets the Attributes from the Nodes
getNavisAttributesFromNodesList = DynaWorks15.Objects.NavisAttributes.GetNavisAttributesFromNodesList(nodeByClassNameList)
string_2 = StringInput("Element ID")
# note: Gets the Element ID from the Attribute Properties
string_3 = StringInput("Value")
getValuesAsStringClassUserName = DynaWorks15.Objects.NavisPropertyList.GetValuesAsStringClassUserName(openFile, getNavisAttributesFromNodesList, string_2, string_3)
flatten = Flatten(getValuesAsStringClassUserName)
toNumber = String.ToNumber(flatten)
containsItem = List.ContainsItem(id, toNumber)
filterByBoolMask = List.FilterByBoolMask(all_elements_of_type, containsItem)
string_4 = StringInput("Comments")
# note: Gets the name of the clash results
string_5 = StringInput("name")
getObjectValues = DynaWorks15.Objects.GetData.GetObjectValues(getAllClashResults, string_5)
flatten_2 = Flatten(getObjectValues)
setParameterByName = Element.SetParameterByName(filterByBoolMask, string_4, flatten_2)
