# Dynamo graph RevitClashFamilies.dyn (Dynamo 0.7.2.2114)

family_types = FamilyTypes(index=5)
file_path = Filename("C:\Users\Adam_Sheather\Desktop\Stripe\DynaWorks Testing\File.nwf")
boolean = BoolSelector(true)
# note: Get Navisworks File
openFile = DynaWorks15.FileSettings.OpenNavisFile.OpenFile(file_path, boolean)
# note: Gets the Clash Detection Object
getClashDetection = DynaWorks15.ClashDetection.ClashDetection.GetClashDetection(openFile)
# note: Gets all the Clash Tests in the Clash Detection
getClashTests = DynaWorks15.ClashDetection.ClashDetection.GetClashTests(getClashDetection)
# note: Gets all the Results in the Clash Tests
getAllClashResults = DynaWorks15.ClashDetection.ClashDetection.GetAllClashResults(getClashTests)
boolean_2 = BoolSelector(true)
# note: Gets the Clash Points as Dynamo Point Objects.
# In MM!!
mGetClashPoint = DynaWorks15.ClashDetection.ClashDetection.mGetClashPoint(getAllClashResults, boolean_2)
# note: Places the Clash Sphere at each Location
byPoint = FamilyInstance.ByPoint(family_types, mGetClashPoint)
