# Dynamo custom node ClashingBoundingBox.dyf (Dynamo 0.7.2.2114)
# category: DynaWorks15.Custom
# Gets the BoundingBox of clashes in metres

OpenNavisFile = Input()
getClashDetection = DynaWorks15.ClashDetection.ClashDetection.GetClashDetection(OpenNavisFile)
getClashTests = DynaWorks15.ClashDetection.ClashDetection.GetClashTests(getClashDetection)
getAllClashResults = DynaWorks15.ClashDetection.ClashDetection.GetAllClashResults(getClashTests)
mGetClashBoundingBox = DynaWorks15.ClashDetection.ClashDetection.mGetClashBoundingBox(getAllClashResults)
BBList = Output(mGetClashBoundingBox)
