# Dynamo custom node GetAllNodes.dyf (Dynamo 0.7.2.2114)
# category: DynaWorks15.Custom
# Gets all the Navisworks Objects in a File

OpenNavisFile = Input()
getFilesInProject = DynaWorks15.Objects.NavisNodes.GetFilesInProject(OpenNavisFile)
getNodeChildren = DynaWorks15.Objects.NavisNodes.GetNodeChildren(getFilesInProject)
getNodeChildren_2 = DynaWorks15.Objects.NavisNodes.GetNodeChildren(getNodeChildren)
getNodeChildren_3 = DynaWorks15.Objects.NavisNodes.GetNodeChildren(getNodeChildren_2)
getNodeChildren_4 = DynaWorks15.Objects.NavisNodes.GetNodeChildren(getNodeChildren_3)
getNodeChildren_5 = DynaWorks15.Objects.NavisNodes.GetNodeChildren(getNodeChildren_4)
getNodeChildren_6 = DynaWorks15.Objects.NavisNodes.GetNodeChildren(getNodeChildren_5)
flatten = Flatten(getNodeChildren_6)
getNodeChildren_7 = DynaWorks15.Objects.NavisNodes.GetNodeChildren(getNodeChildren_6)
flatten_2 = Flatten(getNodeChildren_7)
create = List.Create(getNodeChildren, getNodeChildren_2, getNodeChildren_3, getNodeChildren_4, getNodeChildren_5, flatten, flatten_2)
flatten_3 = Flatten(create)
NodesList = Output(flatten_3)
