# Dynamo custom node GetClashId'sByGroupName.dyf (Dynamo 0.7.2.2114)
# category: DynaWorks15.Custom
# Get Clash Id's from Clashing Groups

OpenNavisFile = Input()
getClashDetection = DynaWorks15.ClashDetection.ClashDetection.GetClashDetection(OpenNavisFile)
getClashTests = DynaWorks15.ClashDetection.ClashDetection.GetClashTests(getClashDetection)
getAllClashResults = DynaWorks15.ClashDetection.ClashDetection.GetAllClashResults(getClashTests)
flatten = Flatten(getAllClashResults)
getClashGroupResults = DynaWorks15.ClashDetection.ClashDetection.GetClashGroupResults(getClashTests)
string = StringInput("GroupPath")
getObjectValues = DynaWorks15.Objects.GetData.GetObjectValues(getClashGroupResults, string)
flatten_2 = Flatten(getObjectValues)
Group_Name = Input()
boolean = BoolSelector(true)
contains = String.Contains(flatten_2, Group_Name, boolean)
filterByBoolMask = List.FilterByBoolMask(flatten, contains)
FirstClashItem_bool = Input()  # "FirstClashItem (bool)"
getClashNodes = DynaWorks15.ClashDetection.ClashDetection.GetClashNodes(filterByBoolMask, FirstClashItem_bool)
string_2 = StringInput("LcRevitComposite")
nodeByClassNameList = DynaWorks15.Objects.NavisNodes.NodeByClassNameList(getClashNodes, string_2)
flatten_3 = Flatten(nodeByClassNameList)
getNavisAttributesFromNodesList = DynaWorks15.Objects.NavisAttributes.GetNavisAttributesFromNodesList(flatten_3)
string_3 = StringInput("Element ID")
string_4 = StringInput("Value")
getValuesAsStringClassUserName = DynaWorks15.Objects.NavisPropertyList.GetValuesAsStringClassUserName(OpenNavisFile, getNavisAttributesFromNodesList, string_3, string_4)
flatten_4 = Flatten(getValuesAsStringClassUserName)
IdList = Output(flatten_4)
