# Dynamo custom node GetClashIds.dyf (Dynamo 0.7.2.2114)
# category: DynaWorks15.Custom
# Get Navisworks Object Clashing Element ID's

OpenNavisFile = Input()
getClashDetection = DynaWorks15.ClashDetection.ClashDetection.GetClashDetection(OpenNavisFile)
getClashTests = DynaWorks15.ClashDetection.ClashDetection.GetClashTests(getClashDetection)
getAllClashResults = DynaWorks15.ClashDetection.ClashDetection.GetAllClashResults(getClashTests)
FirstClashItem_bool = Input()  # "FirstClashItem (bool)"
getClashNodes = DynaWorks15.ClashDetection.ClashDetection.GetClashNodes(getAllClashResults, FirstClashItem_bool)
string = StringInput("LcRevitComposite")
nodeByClassNameList = DynaWorks15.Objects.NavisNodes.NodeByClassNameList(getClashNodes, string)
flatten = Flatten(nodeByClassNameList)
getNavisAttributesFromNodesList = DynaWorks15.Objects.NavisAttributes.GetNavisAttributesFromNodesList(flatten)
string_2 = StringInput("Element ID")
string_3 = StringInput("Value")
getValuesAsStringClassUserName = DynaWorks15.Objects.NavisPropertyList.GetValuesAsStringClassUserName(OpenNavisFile, getNavisAttributesFromNodesList, string_2, string_3)
flatten_2 = Flatten(getValuesAsStringClassUserName)
IdList = Output(flatten_2)
